# Dynamo graph SPACE PLAN EXAMPLE.dyn (Dynamo 1.1.0.2093)

# group: SOME TIPS:
# note: SOME TIPS TO WORK WITH SPACE PLAN GENERATOR :
# 1. Select number of program elements such that the total area is proportionate to the area of the site.
# 2. Start with a small list of programs , say 12-15, with 3-5 departments and see how the system works.
# 3. Play with designSeed sliders to generate design output. Note, not every run of the system will generate successful spaceplan output.
# 4. Play with form generation input parameters to explore different design possibilities.
# 5. Explore the space plan layout by reading the analysis data , to understand how many space plan layout efficiency.
# 6. Export to DWG to work on the design you like further.

# note: Intended site coverage in percentage. Value should be between 0 to 1. For example 0.3 means 30% site coverage, meaning Building Outline Area should be 30% of the site area.
# note: FormBuildingOutline node computes site coverage from the program document. But user can over ride that by providing a site coverage as an input.
siteCoverage = DoubleSlider(0.9, range=0.25..0.9 step 0.05)
# note: Please provide a file path address of a ".sat" file representing site outline.
string_siteoutline = StringInput("C:\Users\subha\Documents\Visual Studio 2015\Projects\SPG DYNS\TESTEDCASESTUDIES\SFDUG CASE BED T\sampleSite.sat")
# note: Site inset value provides site set back value for each side of the site.
site_inset = DoubleSlider(6, range=1..25 step 1)
# note: Cell dimension provideds the length and width of the cell grid. Lower value enables higher precision while computing spatial assignment.
cell_dim = DoubleSlider(4.1, range=1..25 step 0.1)
# note: Design seed represents direct mapping of each space plan to a number. Slide to generate new space plan for same input parameters.
designseed_for_buildingoutline = IntegerSlider(574, range=2..1000 step 1)
# note: High Precision set to true allows as many as 2500 cells to compute space plan. If set to false, maximum cells allowed is limited to 1000. Higher precision set to true, will give results of higher accuracy at the cost of computing time.
boolean_highprecision = BoolSelector(false)
# note: Please provide a file path address of a ".csv" file representing program document.
string = StringInput("C:\Users\subha\Documents\Visual Studio 2015\Projects\SPG DYNS\TESTEDCASESTUDIES\NEW PROGRAMS\programDocSample.csv")
circulation_add_on_factor = DoubleSlider(1.2, range=0.5..2 step 0.05)
boolean_stackoptionsdept = BoolSelector(true)
# note: StackOptionsProg boolean set to true, allows varied program placement on the same building form outline and same department placement. The Program stacking options can be seen on change of Design Seed (for Program) input parameter.
boolean_stackoptionsprog = BoolSelector(true)
makeDataStack = SpacePlanning.ReadData.MakeDataStack(string, circulation_add_on_factor, boolean_stackoptionsdept, boolean_stackoptionsprog)

# group: ATTRACTORS
# note: These attractors and the respective weights allow to shape the form of the building by restricting zones, which are not allowed to place any department or program on the site. Increase the weight value, to see the circle  grow and restrict the building.
number_slider = DoubleSlider(-89.8, range=-500..500 step 0.1)
number_slider_2 = DoubleSlider(115.6, range=-500..500 step 0.1)
code_block = CodeBlock(x=number_slider, y=number_slider_2) { Point2d.ByCoordinates(x,y); }
number_slider_3 = DoubleSlider(102.8, range=-500..500 step 0.1)
number_slider_4 = DoubleSlider(-25, range=-500..500 step 0.1)
code_block_2 = CodeBlock(x=number_slider_3, y=number_slider_4) { Point2d.ByCoordinates(x,y); }
create = List.Create(code_block, code_block_2)
number_slider_5 = DoubleSlider(11.8, range=1..200 step 0.1)
number_slider_6 = DoubleSlider(2, range=1..200 step 0.1)
create_2 = List.Create(number_slider_5, number_slider_6)
pointByPoint2d = stuffer.DynamoGeometry.PointByPoint2d(code_block)
code_block_3 = CodeBlock { 30; }
circleByRadius = SpacePlanning.PolygonUtility.CircleByRadius(create, create_2, code_block_3)
polygonByPolygon2d = stuffer.DynamoGeometry.PolygonByPolygon2d(circleByRadius)
pointByPoint2d_2 = stuffer.DynamoGeometry.PointByPoint2d(code_block_2)

# note: If RemoveNotch is set to true, then while computing the Building Outline, the system will remove any sides from the outline less than an input threshold distance. That input is, "minNotchDistance".
boolean_remove_notch = BoolSelector(true)
# note: The minNotchDistance removes small offsets/ notches from the building outline. Toggle the value to refine the form of the building.
minNotchDistance = DoubleSlider(12.1, range=10..40 step 0.1)
number_slider_7 = DoubleSlider(-239.3, range=-500..500 step 0.1)
# note: AttractorPoint, is a pointer from the user to the system, to let it place the Public Dept closest to the provided attractor point.
number_slider_8 = DoubleSlider(-205.9, range=-500..500 step 0.1)
attractorPoint = CodeBlock(x=number_slider_7, y=number_slider_8) { Point2d.ByCoordinates(x,y); }
# note: Depth of the Kpu Department. It is input as list to account for more than one Kpu Department in the program document.Please match the number of elements in the list with the number of KPU Departments.
kpu_depth1 = DoubleSlider(22, range=12..45 step 0.5)
kpu_depth2 = DoubleSlider(20.5, range=12..45 step 0.5)
create_3 = List.Create(kpu_depth1, kpu_depth2)
# note: Design seed represents direct mapping of each space plan to a number. Slide to generate new space plan for same input parameter and BuildingOutline.
designSeedForDepartment = DoubleSlider(324, range=2..1000 step 1)
# note: Circulation corridor width for the space plan layout.
circulationWidth = DoubleSlider(2.6, range=1..50 step 0.1)
# note: There is now two algorithms written to place KPU depts on the building outline. Toggline kpuPlacementMode value, uses one or the other.
boolean_kpuplacementmode = BoolSelector(true)
# note: Mode3d set to true, allows placing deparments and programs on multiple levels.
boolean_mode3d = BoolSelector(false)
# note: Design seed represents direct mapping of each space plan to a number. Slide to generate new space plan for same input parameter, BuildingOutline and Department Polygons.
# note: RandomAdjacencyDept set to True, allows recomputes adjacency list of the department by shuffling the sequence of department order to be placed on the building outline.
boolean_randomizeadjacencydept = BoolSelector(true)
# note: designSeedRandomizeAdjDept, gives new sequence of department list , on change of the input value.
designSeedRandomizeAdjacencyDept = DoubleSlider(290, range=2..1000 step 1)
# note: When Mode3D is set to true, total building height input is used to set number of floors and building height.
totalbuilding_height = DoubleSlider(75, range=0..500 step 0.1)
# note: Average floor height value represents floor height of every floor.
avgFloorHeight = DoubleSlider(10, range=9..18 step 0.5)
# note: When Mode3D is set to true, NumDeptPerFloor controls maximum number of department placed per floor.
numDeptPerFloor = DoubleSlider(2, range=1..4 step 1)
# note: Width of the Kpu Department. It is input as list to account for more than one Kpu Department in the program document. Please match the number of elements in the list with the number of KPU Departments.
kpu_width1 = DoubleSlider(23.5, range=4..25 step 0.5)
kpu_width2 = DoubleSlider(23, range=10..25 step 0.5)
create_4 = List.Create(kpu_width1, kpu_width2)
# note: Min allowed dimension of a polygon ( length or width ) to be acceptable to be assigned to any program space.
minAllowedDimension = DoubleSlider(4, range=1..20 step 0.1)
designSeedForProgram = DoubleSlider(901, range=2..1000 step 1)
# note: CheckAspectRatio if set to true, will check the program polygons for acceptable aspect ratio ( length/width ) and will discard any which does not meet the requirement.
boolean_checkaspectratio = BoolSelector(false)
# note: Z Axis value for visualization of surfaces representing program spaces.
heightPolylinesRegSpaces = DoubleSlider(0, range=-10..100 step 0.1)
# note: Input selects the color scheme for visualizing space plan programs.
colorSchemeSpacePlan = IntegerSlider(15, range=0..100 step 1)
# note: ColorProgramSeparate set to true, visualizes each program space with an unique color. Set to false, each department programs are visualized with one color.
boolean_colorprogramseparate = BoolSelector(false)
# note: Opacity of the colors for visualization.
opacity = DoubleSlider(5, range=0..100 step 1)
# note: Z Axis value for visualization of Program polygons and Program texts.
textPolyLinesKPULinesHeight = DoubleSlider(0.2, range=0..10 step 0.1)
# note: FullProgramNames, when set to true, allows visualization of full program names. Set to false, visualizes abbreviated program names ( short form ).
boolean_fullprogramnames = BoolSelector(true)
# note: Scale value for the text visualization representing program names on the space plan.
textScale = DoubleSlider(1, range=0.3..2 step 0.1)
# note: Rotation angle for the text visualization representing program names on the space plan.
textRotationAngle = DoubleSlider(37.6, range=0..100 step 0.1)
# note: User weight for one of the space plan evaluation metric - Program Fitness on Site. Value should be between 0-1.
programFitWeight = DoubleSlider(0.9, range=0.1..1 step 0.1)
# note: User weight for one of the space plan evaluation metric - External View of KPU. Value should be between 0-1.
extViewWeight = DoubleSlider(1, range=0.1..1 step 0.1)
# note: User weight for one of the space plan evaluation metric - Travel distance from a support space to the KPU's. Value should be between 0-1.
travDistWeight = DoubleSlider(0.9, range=0.1..1 step 0.1)
percKPUWeight = DoubleSlider(0.9, range=0.1..1 step 0.1)
# note: Please copy-paste your program document string from a.csv file into a string node and connect to MakeDataStackFromString node's programDocumentString input.
# note: Circulation add on factor is multipled with the area requirement from the provided program document, to account for the area needed for circulation spaces. Minimum value should be 1. Any value above 1 would ensure surpluss area alotted to circulation spaces.
# note: StackOptionsDept boolean set to true, allows varied department placement on the same building form outline. The Department stacking options can be seen on change of Design Seed (for Dept) input parameter.
# note: You can either, copy paste your program document here or you can provide a file path of a ".csv" program document file.
string_programdocument = StringInput("""PROGRAM ID,PROGRAM NAME,ZONE/ DEPARTMENT,QUANTITY,AREA,TOTAL AREA,PREFERENCEPOINT VALUE,PROGRAM TYPE,ADJACENT PROGRAMS,DEPT ID,ADJACENT DEPT
0,Public Toilet,Family Public Support,2,160,320,6,PUBLIC,,0,3.2
1,Lobby,Family Public Support,1,550,550,10,PUBLIC,,0,2
2,Patient Room,Inpatient Area,22,420,9240,10,KPU,,1,3.4
3,Exam Room General,Exam Area,6,400,2400,10,KPU,,2,0.1
4,Alcove Charting Room,Clinic Support,4,75,300,10,REGULAR,,3,4.2.0
5,Team Work station,Clinic Support,2,288,576,9,REGULAR,,3,
6,Soiled Utility,Clinic Support,1,300,300,8,REGULAR,,3,
7,Nourishment Room Family,Clinic Support,1,65,65,7,REGULAR,,3,
8,Staff Lounge,Shared Staff Support,1,420,420,9,REGULAR,,4,3.2
9,Kitchen,Shared Staff Support,1,150,150,8,REGULAR,,4,
10,Conference,Shared Staff Support,3,300,900,10,REGULAR,,4,
11,Staff Respite Room,Shared Staff Support,1,80,80,7,REGULAR,,4,""")

# group: DATA STACK
code_block_4 = CodeBlock(siteOutline=string_siteoutline) { siteOutline; }
getSiteOutlineFromSat = SpacePlanning.ReadData.GetSiteOutlineFromSat(code_block_4)
convertSiteOutlineToPolygon2d = SpacePlanning.ReadData.ConvertSiteOutlineToPolygon2d(getSiteOutlineFromSat, site_inset)
code_block_5 = CodeBlock(progDocString=string_programdocument) { progDocString; }
makeDataStackFromString = SpacePlanning.ReadData.MakeDataStackFromString(circulation_add_on_factor, code_block_5, boolean_stackoptionsdept, boolean_stackoptionsprog)

# group: BUILDING FORM
findOrthoSiteOutline = SpacePlanning.GridObject.FindOrthoSiteOutline(convertSiteOutlineToPolygon2d, cell_dim, designseed_for_buildingoutline, boolean_highprecision)
# note: Z axis value of all the visualized geometry, i.e. Polygons, Surfaces etc.
heights = CodeBlock { cirHtP = 1.25; ht2 = -0.1; {}; 150; }
makeCellPolysFromCellObjects = SpacePlanning.GridObject.MakeCellPolysFromCellObjects(findOrthoSiteOutline.out3, heights.out2, heights.ht2)
byARGB = Color.ByARGB(a=heights.out3, r=heights.out3, g=heights.out3, b=heights.out3)
byGeometryColor = Display.Display.ByGeometryColor(makeCellPolysFromCellObjects, byARGB)

formBuildingOutline = SpacePlanning.GridObject.FormBuildingOutline(findOrthoSiteOutline.out0, findOrthoSiteOutline.out3, makeDataStack, create, create_2, arg6=designseed_for_buildingoutline, arg7=boolean_remove_notch, arg8=minNotchDistance)

# group (continued): BUILDING FORM
code_block_6 = CodeBlock(buildOutline=formBuildingOutline.out0) { buildOutline; }
site_area = Watch(formBuildingOutline.out1)
site_coverage_achieved = Watch(formBuildingOutline.out5)
polygonByPolygon2d_2 = stuffer.DynamoGeometry.PolygonByPolygon2d(formBuildingOutline.out0, heights.cirHtP)

# group: DEPT & PROGRAM PLACEMENT
placeDepartments = SpacePlanning.BuildLayout.PlaceDepartments(makeDataStack, code_block_6, attractorPoint, create_3, designSeedForDepartment, circulationWidth, boolean_kpuplacementmode, boolean_mode3d, boolean_randomizeadjacencydept, designSeedRandomizeAdjacencyDept, totalbuilding_height, avgFloorHeight, numDeptPerFloor)
placePrograms = SpacePlanning.BuildLayout.PlacePrograms(placeDepartments, create_4, minAllowedDimension, designSeedForProgram, boolean_checkaspectratio)

# group: VISUALIZE ANALYSE
visualizeDeptPrograms = SpacePlanning.SpaceAnalysis.VisualizeDeptPrograms(placePrograms, heightPolylinesRegSpaces, colorSchemeSpacePlan, boolean_colorprogramseparate, opacity)
visualizeProgramPolyLinesAndOrigin = SpacePlanning.SpaceAnalysis.VisualizeProgramPolyLinesAndOrigin(placePrograms, textPolyLinesKPULinesHeight, heightPolylinesRegSpaces, boolean_fullprogramnames)
fromStringOriginAndScale = DynamoText.Text.FromStringOriginAndScale(visualizeProgramPolyLinesAndOrigin.out2, visualizeProgramPolyLinesAndOrigin.out1, textScale)  # frozen
ZAxis = Vector.ZAxis()
rotate = Geometry.Rotate(geometry=fromStringOriginAndScale, origin=visualizeProgramPolyLinesAndOrigin.out1, axis=ZAxis, degrees=textRotationAngle)  # frozen
spacePlanFitnessTest = SpacePlanning.SpaceAnalysis.SpacePlanFitnessTest(placePrograms, formBuildingOutline.out6, formBuildingOutline.out1, programFitWeight, extViewWeight, travDistWeight, percKPUWeight)
spacePlanFitnessVisualize = SpacePlanning.SpaceAnalysis.SpacePlanFitnessVisualize(spacePlanFitnessTest.out0, spacePlanFitnessTest.out1, spacePlanFitnessTest.out2, spacePlanFitnessTest.out3, spacePlanFitnessTest.out4, spacePlanFitnessTest.out5, convertSiteOutlineToPolygon2d)
fromStringOriginAndScale_2 = DynamoText.Text.FromStringOriginAndScale(spacePlanFitnessVisualize.out0, spacePlanFitnessVisualize.out1, spacePlanFitnessVisualize.out4)
visualizeDepartments = SpacePlanning.SpaceAnalysis.VisualizeDepartments(placeDepartments)  # frozen
colorCorridors = CodeBlock { 1; }

# group: DESIGN DETAILS
buildingArea = Watch(formBuildingOutline.out3)
deptAreaProvided = SpacePlanning.DeptData.DeptAreaProvided(placePrograms)
departmentAbbrev = SpacePlanning.DeptData.DepartmentAbbrev(placePrograms)
deptAreaNeeded = SpacePlanning.DeptData.DeptAreaNeeded(placePrograms)
building_area_needed = Math.Sum(deptAreaNeeded)
# note: These specify the details of a generated space plan layout. Please review these to identify programs and departments placed on the site.
programsInDept = SpacePlanning.DeptData.ProgramsInDept(placePrograms)
programName = SpacePlanning.ProgramData.ProgramName(programsInDept)
progPreferenceVal = SpacePlanning.ProgramData.ProgPreferenceVal(programsInDept)
quantity = SpacePlanning.ProgramData.Quantity(programsInDept)
progAreaProvided = SpacePlanning.ProgramData.ProgAreaProvided(programsInDept)
progAreaNeeded = SpacePlanning.ProgramData.ProgAreaNeeded(programsInDept)

site_coverage_required = Watch(formBuildingOutline.out4)

# group: EXPORT DATA
code_block_7 = CodeBlock { "D:/cellData.xlsx"; "1"; 0; true; }
exportCellData = SpacePlanning.SpaceAnalysis.ExportCellData(placePrograms, formBuildingOutline.out6, formBuildingOutline.out7)  # frozen
writeToFile = Excel.WriteToFile(filePath=code_block_7.out0, sheetName=code_block_7.out1, startRow=code_block_7.out2, startCol=code_block_7.out2, data=exportCellData, overWrite=code_block_7.out3)
code_block_8 = CodeBlock { "D:/programData.xlsx"; "1"; 0; true; }
# note: Please add the filepath where you want to save the excel export file.
exportDepartmentProgramData = SpacePlanning.SpaceAnalysis.ExportDepartmentProgramData(placeDepartments)  # frozen
writeToFile_2 = Excel.WriteToFile(filePath=code_block_8.out0, sheetName=code_block_8.out1, startRow=code_block_8.out2, startCol=code_block_8.out2, data=exportDepartmentProgramData, overWrite=code_block_8.out3)

pointByPoint2d_3 = stuffer.DynamoGeometry.PointByPoint2d(attractorPoint)

# group: EXPORT DWG
code_block_9 = CodeBlock { "D:/planNew.dwg"; }
# note: Please add the filepath where you want to save the dwg file.
create_5 = List.Create(getSiteOutlineFromSat, visualizeProgramPolyLinesAndOrigin.out0)
flatten = Flatten(create_5)
fromGeometries = Dynamo.Translation.FileWriter.FromGeometries(code_block_9, flatten)

# note: Z Axis value for visualization of circulation in the space plan.
circulationHeight = DoubleSlider(0.1, range=0..5 step 0.1)
visualizeCirculation = SpacePlanning.SpaceAnalysis.VisualizeCirculation(placePrograms, circulationHeight, colorCorridors, opacity)
